# Grasshopper definition json_to_rhino_model.gh (Grasshopper 1.0.7)
# plug-ins: ShapeDiverForGrasshopper

ghpython_script = GhPythonScript()  # -> out, a, b, c, d, e
# ---------- ghpython_script: Python ----------
__author__ = "jakub"
__version__ = "2024.11.23"

import rhinoscriptsyntax as rs
import Rhino.Geometry as rg
import json

# Load the JSON data
filepath = r"C:\Users\jakub\Desktop\test_folder\reformatted_building_geometry.json"
with open(filepath, 'r') as file:
    data = json.load(file)

# Helper function to create Brep from vertices
def create_brep(vertices):
    points = [rg.Point3d(v['x'], v['y'], v['z']) for v in vertices]
    polyline = rg.Polyline(points + [points[0]])  # Close the loop
    brep = rg.Brep.CreateFromCornerPoints(points[0], points[1], points[2], points[3], 0.01)
    return brep

# Helper function to subtract openings from walls
def subtract_openings(wall_brep, opening_breps):
    result = wall_brep
    for opening in opening_breps:
        diff = rg.Brep.CreateBooleanDifference([result], [opening], 0.01)
        if diff:  # Ensure a valid result
            result = diff[0]
    return result

# Helper function to create LineCurve
def create_line_curve(start, end):
    start_point = rg.Point3d(start['x'], start['y'], start['z'])
    end_point = rg.Point3d(end['x'], end['y'], end['z'])
    return rg.LineCurve(start_point, end_point)

# Generate walls, floors, and openings as Breps
walls_breps = [create_brep(wall['vertices']) for wall in data['components']['walls']]
floors = [create_brep(floor['vertices']) for floor in data['components']['floors']]
openings_breps = [create_brep(opening['vertices']) for opening in data['components']['openings']]

# Subtract openings from walls
walls_with_openings = [subtract_openings(wall, openings_breps) for wall in walls_breps]

# Generate beams and columns as curves
columns = [create_line_curve(col['startPoint'], col['endPoint']) for col in data['components']['columns']]
beams = [create_line_curve(beam['startPoint'], beam['endPoint']) for beam in data['components']['beams']]

# Output to Grasshopper
a = walls_with_openings  # Walls with openings subtracted
b = floors
c = openings_breps       # Openings as separate Breps (optional if needed)
d = columns
e = beams
# ---------- end ghpython_script ----------
geometry = Geometry(ghpython_script.b)
geometry_2 = Geometry(ghpython_script.c)
geometry_3 = Geometry(ghpython_script.a)
# Currently there columns and beams lists in JSON are empty, this is why the wires are orange
geometry_4 = Geometry(ghpython_script.d)
geometry_5 = Geometry(ghpython_script.e)
panel = Panel(geometry_2)
panel_2 = Panel(geometry_4)
panel_3 = Panel(geometry_5)
panel_4 = Panel(geometry)
# Get data from JSON?
# GET POINTS, FACES? FROM DATA
# POINTS, FACES TO GEOMETRY?
panel_5 = Panel(geometry_3)
custom_preview = CustomPreview(Geometry=geometry_3, Material=ColourSwatch(SwatchColor=RGB(255, 0, 0)))
custom_preview_2 = CustomPreview(Geometry=geometry_2, Material=ColourSwatch(SwatchColor=RGB(39, 105, 219)))
custom_preview_3 = CustomPreview(Geometry=geometry, Material=ColourSwatch(SwatchColor=RGB(26, 219, 110)))
custom_preview_4 = CustomPreview(Geometry=geometry_4, Material=ColourSwatch(SwatchColor=RGB(255, 0, 234)))
custom_preview_5 = CustomPreview(Geometry=geometry_5, Material=ColourSwatch(SwatchColor=RGB(255, 174, 0)))
brep = Brep([geometry_3, geometry])
shapediver_output = ShapeDiverOutput(
    Out4=brep,
    ParameterSchemas="""={
  "c5e255aa-bfd3-4adf-852c-e14fc57e1559": {
    "UniversalProperties": {
      "Structure": "item",
      "Guid": "d7b7ab3b-ee3b-4486-b20b-7be748c89dc1",
      "ParamUiIndex": 673,
      "ParamGroupGuid": "7ad32771-f90a-48e0-a7b2-9b265bc65db6",
      "Name": "Brep",
      "Description": "",
      "TypeCode": 210
    },
    "ImplementationType": "unknown",
    "ImplementationProperties": {}
  }
}""")
